# Grasshopper definition arm-lattice.gh (Grasshopper 1.0.8)
# plug-ins: Pufferfish, Anemone Classic, LunchBox, Weaverbird, MetaHopper

thickness = Slider(2, range=0..10)
ends_thickness = Slider(3, range=0..10)
# 4. Custom preferences
length_pattern = Slider(12, range=0..100)
width_pattern = Slider(12, range=0..100)
pointness = Slider(3, range=-10..10)
width = Slider(6, range=0..30)
mid_thickness_factor = Slider(1.2, range=0..5)
gap_between_scan_and_structure = Slider(5, range=0..30)

# ----
# 1. Insert mesh here
arm = Mesh(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)

group_toggle = GroupToggle(ToggleActive=True, ToggleVisible=False)  # disabled

bounding_box = BoundingBox(Content=arm, Plane=PlaneXY(0, 0, 0))  # -> Box, Box_2
volume = Volume(Geometry=arm)  # -> Volume, Centroid
deconstruct_brep = DeconstructBrep(Brep=bounding_box.Box)  # -> Faces, flatten(Edges), Vertices
# Automatic scale
length = Length(Curve=deconstruct_brep.Edges)
highest_lowest_numbers = HighestLowestNumbers(Numbers=length)  # -> Highest, Lowest
python_3_script = Python3Script(N=highest_lowest_numbers.Highest)  # -> A, F; inputs N: Double
# ---------- python_3_script: Python ----------
"""Scale a number to three digits and report the factor used.

Input:
    N : number (or list of numbers)
Outputs:
    A : N scaled into [100, 1000)
    F : the factor applied, so that A = N * F  (and N = A / F)
"""

def to_three_digits(value):
    if value is None:
        return None, None

    n = float(value)
    if n == 0:
        return 0.0, 1.0

    sign = -1.0 if n < 0 else 1.0
    n = abs(n)
    exp = 0

    while n < 100.0:      # 2 digits or fewer -> scale up
        n *= 10.0
        exp += 1
    while n >= 1000.0:    # 4 digits or more -> scale down
        n /= 10.0
        exp -= 1

    return sign * round(n, 10), 10.0 ** exp


if isinstance(N, (list, tuple)):
    results = [to_three_digits(v) for v in N]
    A = [r[0] for r in results]
    F = [r[1] for r in results]
else:
    A, F = to_three_digits(N)
# ---------- end python_3_script ----------
scale = Scale(Geometry=arm, Center=volume.Centroid, Factor=python_3_script.F)  # -> Geometry, Transform
mesh = Mesh(scale.Geometry)

custom_preview = CustomPreview(Geometry=scale.Geometry, Material=ColourSwatch(SwatchColor=RGBA(62, 99, 98, 108)))
number_slider = Slider(268, range=0..1000)
re_run_wrapping = Button()

number_slider_2 = Slider(2, range=0..10)
division = Division(A=width_pattern, B=number_slider_2)
multiplication = Multiplication(A=width_pattern, B=number_slider_2)
subtraction = Subtraction(A=multiplication, B=division)

# ----
# 3. Start script
colour_swatch = ColourSwatch(SwatchColor=RGBA(64, 79, 99, 38))
# 2. Choose boundaries
start = Slider(0.29, range=0..1)
end = Slider(0.69, range=0..1)

bounding_box_2 = BoundingBox(Content=mesh, Plane=PlaneXY(0, 0, 0))  # -> Box, Box_2
deconstruct_brep_2 = DeconstructBrep(Brep=bounding_box_2.Box)  # -> Faces, Edges, Vertices
area = Area(Geometry=deconstruct_brep_2.Faces)  # -> Area, Centroid
sort_list = SortList(Keys=area.Area, ValuesValuesA=deconstruct_brep_2.Faces)  # -> Keys, ValuesValuesA
list_item = ListItem(List=sort_list.ValuesValuesA, Index=0, Wrap=True)  # -> Item, Item1
area_2 = Area(Geometry=list_item.Item)  # -> Area, Centroid
area_3 = Area(Geometry=list_item.Item1)  # -> Area, Centroid
line = Line(StartPoint=area_2.Centroid, EndPoint=area_3.Centroid)
evaluate_curve = EvaluateCurve(Curve=reparameterize(line), Parameter=[start, end])  # -> flatten(Point), Tangent, Angle
list_item_2 = ListItem(List=evaluate_curve.Point, Index=0, Wrap=True)  # -> Item, Item1
number_slider_3 = Slider(6, range=0..10)
line_2 = Line(StartPoint=list_item_2.Item, EndPoint=list_item_2.Item1)
deconstruct_brep_3 = DeconstructBrep(Brep=list_item.Item)  # -> Faces, Edges, Vertices
divide_curve = DivideCurve(Curve=line_2, Count=number_slider_3, Kinks=False)  # -> Points, Tangents, Parameters
length_2 = Length(Curve=deconstruct_brep_3.Edges)
curve_closest_point = CurveClosestPoint(Point=divide_curve.Points, Curve=line_2)  # -> Point, Parameter, Distance
highest_lowest_numbers_2 = HighestLowestNumbers(Numbers=length_2)  # -> Highest, Lowest
perp_frame = PerpFrame(Curve=line_2, Parameter=curve_closest_point.Parameter)
mesh_plane = MeshPlane(Mesh=mesh, Plane=perp_frame)
divide_curve_2 = DivideCurve(Curve=mesh_plane, Count=10, Kinks=False)  # -> Points, Tangents, Parameters
# Initial surface
circle_fit = CircleFit(Points=divide_curve_2.Points)  # -> flatten(Circle), flatten(Radius), Deviation
area_4 = Area(Geometry=circle_fit.Circle)  # -> Area, Centroid
interpolate = Interpolate(Vertices=area_4.Centroid, Degree=3, Periodic=False, KnotStyle=1)  # -> Curve, Length, Domain
divide_curve_3 = DivideCurve(Curve=interpolate.Curve, Count=number_slider_3, Kinks=False)  # -> Points, Tangents, Parameters
curve_closest_point_2 = CurveClosestPoint(Point=divide_curve_3.Points, Curve=interpolate.Curve)  # -> Point, Parameter, Distance
perp_frame_2 = PerpFrame(Curve=interpolate.Curve, Parameter=curve_closest_point_2.Parameter)
multiplication_2 = Multiplication(A=circle_fit.Radius, B=Slider(1.3, range=0..10))
circle = Circle(Plane=perp_frame_2, Radius=multiplication_2)
number_slider_4 = Slider(16, range=0..100)
loft = Loft(Curves=circle, Options={Adjust=False, Closed=False, LoftEnds=0, LoftSimp=0, LoftType=0, Rebuild=10, Refit=0.01})
surface = Surface(loft)
mesh_surface = MeshSurface(Surface=surface, UCount=number_slider_4, VCount=number_slider_4, Overhang=True, Equalize=False)
deconstruct_mesh = DeconstructMesh(Mesh=mesh_surface)  # -> Vertices, Faces, Colours, Normals
mesh_closest_point = MeshClosestPoint(Point=deconstruct_mesh.Vertices, Mesh=mesh)  # -> Point, Index, Parameter
construct_mesh = ConstructMesh(Vertices=mesh_closest_point.Point, Faces=deconstruct_mesh.Faces)

perp_frame_3 = PerpFrame(Curve=line, Parameter=[start, end])
rectangle = Rectangle(Plane=perp_frame_3, XSize=number_slider, YSize=number_slider, Radius=0)  # -> Rectangle, Length
area_5 = Area(Geometry=rectangle.Rectangle)  # -> Area, Centroid
move_to_point = MoveToPoint(Geometry=rectangle.Rectangle, PointA=area_5.Centroid, PointB=evaluate_curve.Point)  # -> Moved, Vector, Transform
surface_2 = Surface(move_to_point.Moved)

custom_preview_2 = CustomPreview(Geometry=surface_2, Material=colour_swatch)

loop_start = LoopStart(Repeat=Slider(20, range=0..100), Trigger=re_run_wrapping, Data=construct_mesh)  # -> port, Counter, Data
# Fitting to mesh
weaverbird_s_laplacian_smoothing = WeaverbirdsLaplacianSmoothing(MeshCurves=loop_start.Data, Level=Slider(1, range=0..100), SmoothNakedEdges=0, Thin=1)
deconstruct_mesh_2 = DeconstructMesh(Mesh=weaverbird_s_laplacian_smoothing)  # -> Vertices, Faces, Colours, Normals
mesh_closest_point_2 = MeshClosestPoint(Point=deconstruct_mesh_2.Vertices, Mesh=mesh)  # -> Point, Index, Parameter
construct_mesh_2 = ConstructMesh(Vertices=mesh_closest_point_2.Point, Faces=deconstruct_mesh_2.Faces)
loop_end = LoopEnd(port=loop_start.port, Exit=False, Data=construct_mesh_2, TimeOutVal=0, pausedState=False, state="Output last")
data = Data(gap_between_scan_and_structure)

weaverbird_s_offset_mesh = WeaverbirdsOffsetMesh(MeshCurves=loop_end, Distance=expr("-x", data), OffsetType=0)
# Convert back to brep surface
deconstruct_mesh_3 = DeconstructMesh(Mesh=weaverbird_s_offset_mesh)  # -> Vertices, Faces, Colours, Normals
partition_list = PartitionList(List=deconstruct_mesh_3.Vertices, Size=number_slider_4)
interpolate_2 = Interpolate(Vertices=partition_list, Degree=3, Periodic=True, KnotStyle=1)  # -> flatten(Curve), Length, Domain
number_slider_5 = Slider(45, range=0..100)
loft_2 = Loft(
    Curves=interpolate_2.Curve,
    Options={Adjust=False, Closed=False, LoftEnds=0, LoftSimp=0, LoftType=0, Rebuild=10, Refit=0.01})
rebuild_surface = RebuildSurface(Surface=loft_2, UDegree=3, VDegree=3, UNumber=number_slider_5, VNumber=number_slider_5)

hexagon_cells = HexagonCells(Surface=rebuild_surface, UDivisions=length_pattern, VDivisions=width_pattern, TParameter=0.25)  # -> HexagonCells, Centers
explode = Explode(Curve=hexagon_cells.HexagonCells, Recursive=True)  # -> Segments, Vertices
division_2 = Division(A=width_pattern, B=Slider(2, range=0..10))
prune_tree = PruneTree(Tree=explode.Segments, Minimum="5", Maximum="5")
subtraction_2 = Subtraction(A=length_pattern, B=Slider(2, range=0..10))
subtraction_3 = Subtraction(A=division_2, B=Slider(1, range=0..1))
join_curves = JoinCurves(Curves=prune_tree, Preserve=False)  # -> flatten(Curves)
series = Series(Start=subtraction_3, Step=1, Count=subtraction_2)
# Removing seam line from hexagon pattern
prune_tree_2 = PruneTree(Tree=explode.Segments, Minimum="6", Maximum="6")
list_item_3 = ListItem(List=join_curves, Index=series, Wrap=True)
partition_list_2 = PartitionList(List=list_item_3, Size=Slider(2, range=0..10))
list_item_4 = ListItem(List=partition_list_2, Index=0, Wrap=True)
explode_2 = Explode(Curve=partition_list_2, Recursive=True)  # -> Segments, Vertices
cull_duplicates = CullDuplicates(Points=explode_2.Vertices, Tolerance=0.1, CullMode=1)  # -> Points, Indices, Valence
partition_list_3 = PartitionList(List=flatten(cull_duplicates.Points), Size=Slider(10, range=0..10))
cull_duplicates_2 = CullDuplicates(Points=partition_list_3, Tolerance=0.1, CullMode=2)  # -> Points, Indices, Valence
sort_along_curve = SortAlongCurve(Points=cull_duplicates_2.Points, Curve=list_item_4)  # -> Points, Indices
polyline = PolyLine(Vertices=sort_along_curve.Points, Closed=True)
explode_3 = Explode(Curve=polyline, Recursive=True)  # -> Segments, Vertices
merge = Merge(Data1=prune_tree_2, Data2=explode_3.Segments)

curve_middle = CurveMiddle(Curve=merge)
average = Average(Input=curve_middle)
brep_closest_point = BrepClosestPoint(Point=average, Brep=rebuild_surface)  # -> Point, simplify(Normal), Distance
reverse = Reverse(Vector=brep_closest_point.Normal)
# 3D pattern
merge_2 = Merge(Data1=brep_closest_point.Normal, Data2=reverse)
repeat_data = RepeatData(Data=merge_2, Length="6")
data_2 = Data(pointness)
amplitude = Amplitude(Vector=repeat_data, Amplitude=data_2)
move = Move(Geometry=average, Motion=amplitude)  # -> Geometry, Transform
line_3 = Line(StartPoint=curve_middle, EndPoint=move.Geometry)  # -> flatten(Line)

brep_edges = BrepEdges(Brep=rebuild_surface)  # -> Naked, Interior, NonManifold
join_curves_2 = JoinCurves(Curves=merge, Preserve=False)
list_item_5 = ListItem(List=brep_edges.Naked, Index=0, Wrap=True)  # -> Item, Item1
weaverbird_s_tile = WeaverbirdsTile(MeshCurves=flatten(join_curves_2), FillStrategy=1, OptIn=2)
curve = Curve(list_item_5.Item1)
curve_2 = Curve(list_item_5.Item)
divide_curve_4 = DivideCurve(Curve=curve, Count=10, Kinks=False)  # -> Points, Tangents, Parameters
mesh_edges = MeshEdges(Mesh=weaverbird_s_tile)  # -> NakedEdges, InteriorEdges, NonManifoldEdges
circle_fit_2 = CircleFit(Points=divide_curve_4.Points)  # -> Circle, Radius, Deviation
join_curves_3 = JoinCurves(Curves=mesh_edges.NakedEdges, Preserve=False)
area_6 = Area(Geometry=circle_fit_2.Circle)  # -> Area, Centroid
polygon_center = PolygonCenter(Polyline=join_curves_3)  # -> CenterV, CenterE, CenterA
distance = Distance(PointA=area_6.Centroid, PointB=polygon_center.CenterV)
sort_list_2 = SortList(Keys=distance, ValuesValuesA=join_curves_3)  # -> Keys, ValuesValuesA
list_item_6 = ListItem(List=sort_list_2.ValuesValuesA, Index=0, Wrap=True)  # -> Item, Item1

# ----
# End crowns
explode_4 = Explode(Curve=list_item_6.Item, Recursive=True)  # -> flatten(Segments), Vertices
curve_middle_2 = CurveMiddle(Curve=explode_4.Segments)
curve_closest_point_3 = CurveClosestPoint(Point=curve_middle_2, Curve=curve)  # -> Point, Parameter, Distance
sort_list_3 = SortList(Keys=curve_closest_point_3.Distance, ValuesValuesA=explode_4.Segments)  # -> Keys, ValuesValuesA
series_2 = Series(Start=0, Step=1, Count=subtraction)
list_item_7 = ListItem(List=reverse(sort_list_3.ValuesValuesA), Index=series_2, Wrap=True)
join_curves_4 = JoinCurves(Curves=list_item_7, Preserve=False)
end_points = EndPoints(Curve=join_curves_4)  # -> Start, End
merge_3 = Merge(Data1=end_points.Start, Data2=end_points.End)  # -> flatten(Result)
sort_along_curve_2 = SortAlongCurve(Points=merge_3, Curve=curve)  # -> Points, Indices
interpolate_3 = Interpolate(Vertices=sort_along_curve_2.Points, Degree=3, Periodic=True, KnotStyle=1)  # -> Curve, Length, Domain
curve_closest_point_4 = CurveClosestPoint(Point=sort_along_curve_2.Points, Curve=interpolate_3.Curve)  # -> Point, Parameter, Distance
shatter = Shatter(Curve=interpolate_3.Curve, Parameters=curve_closest_point_4.Parameter)
merge_4 = Merge(Data1=list_item_7, Data2=shatter)  # -> flatten(Result)

explode_5 = Explode(Curve=list_item_6.Item1, Recursive=True)  # -> flatten(Segments), Vertices
curve_middle_3 = CurveMiddle(Curve=explode_5.Segments)
curve_closest_point_5 = CurveClosestPoint(Point=curve_middle_3, Curve=curve_2)  # -> Point, Parameter, Distance
sort_list_4 = SortList(Keys=curve_closest_point_5.Distance, ValuesValuesA=explode_5.Segments)  # -> Keys, ValuesValuesA
series_3 = Series(Start=0, Step=1, Count=subtraction)
list_item_8 = ListItem(List=reverse(sort_list_4.ValuesValuesA), Index=series_3, Wrap=True)
join_curves_5 = JoinCurves(Curves=list_item_8, Preserve=False)
end_points_2 = EndPoints(Curve=join_curves_5)  # -> Start, End
merge_5 = Merge(Data1=end_points_2.Start, Data2=end_points_2.End)  # -> flatten(Result)
sort_along_curve_3 = SortAlongCurve(Points=merge_5, Curve=curve_2)  # -> Points, Indices
interpolate_4 = Interpolate(Vertices=sort_along_curve_3.Points, Degree=3, Periodic=True, KnotStyle=1)  # -> Curve, Length, Domain
curve_closest_point_6 = CurveClosestPoint(Point=sort_along_curve_3.Points, Curve=interpolate_4.Curve)  # -> Point, Parameter, Distance
shatter_2 = Shatter(Curve=interpolate_4.Curve, Parameters=curve_closest_point_6.Parameter)
merge_6 = Merge(Data1=list_item_8, Data2=shatter_2)  # -> flatten(Result)

flat_multipipe = Script(Curves=flatten(line_3), Base=rebuild_surface, NodeSize=width, StrutSize=mid_thickness_factor)  # -> out, Outlines, Mesh; inputs Curves: list of Curve, Base: Brep, NodeSize: list of Double, SizePoints: list of Point3d, StrutSize: Double, EndOffset: Double
# ---------- flat_multipipe: Python ----------
#! python 3
# -*- coding: utf-8 -*-
"""
FlatPipe - a flat-profile stand-in for Rhino 8's MultiPipe.

Takes the same kind of branching line/curve network MultiPipe takes and fattens
every strut into a FLAT RIBBON instead of a round tube.  Each ribbon lies in the
tangent plane of a base surface, so the lattice reads as flat webbing laid onto
the form.  Ribbons are welded to each other at the nodes: a single mesh, shared
vertices, no booleans needed downstream.

--------------------------------------------------------------------------
SET UP THE COMPONENT (Rhino 8 Script component, language = Python 3)
--------------------------------------------------------------------------
  INPUTS                                                   type      access
    Curves      curve network (lines / polylines / curves)  Curve     List
    Base        surface, brep or mesh to align ribbons to   Brep*     Item
    NodeSize    half-width at each node (= MultiPipe radius) Number    List
    SizePoints  which node each NodeSize belongs to          Point     List
    StrutSize   mid-strut width multiplier (<1 taper)        Number    Item
    EndOffset   junction size, as a multiple of NodeSize     Number    Item

    * set Base's type hint to Brep; it also accepts a Surface or a Mesh.
      Base is optional - without it each node falls back to a best-fit plane
      through its own struts.

  OUTPUTS
    Mesh        the welded flat lattice
    Outlines    naked-edge polylines of the result (cut lines / unrolling)

--------------------------------------------------------------------------
HOW THE MultiPipe INPUTS MAP OVER
--------------------------------------------------------------------------
  NodeSize   is a radius in MultiPipe, so it is used here as a HALF width.
             A ribbon is 2*NodeSize wide, matching the pipe's diameter.
  StrutSize  multiplies the width at the middle of each strut, exactly like
             MultiPipe: <1 gives tapering struts, >1 gives bulging ones.
  EndOffset  sets how far the strut mouth sits from the node.  A geometric
             minimum is always enforced (otherwise neighbouring ribbons would
             cross inside the junction), so values below ~1.0 have little
             effect.
  Curves running along the surface normal (the "spike" struts in an armour
  lattice) have no tangent-plane direction to spread into.  They become blades
  standing off the surface, aimed into the widest gap between the other struts
  at that node.
  KinkAngle / Segment / CubeFit / Caps are not carried over: they only mean
  something for a SubD tube.
"""

import math
import Rhino
import Rhino.Geometry as rg

# ------------------------------------------------------------------ tuning
MIN_SPANS = 2            # minimum quads along a strut
MAX_SPANS = 12           # maximum quads along a strut
BLADE_DOT = 0.94         # |dir . normal| above this -> strut is a blade
MAX_MITER = 4.0          # junction offset clamp, as a multiple of NodeSize
MAX_SIZE_RATIO = 0.45    # a node's half width, as a fraction of its shortest strut
FALLBACK_DIVISIONS = 24  # segments used when a curve cannot be polylined


def _tol():
    doc = Rhino.RhinoDoc.ActiveDoc
    return doc.ModelAbsoluteTolerance if doc else 0.001


def _ang_tol():
    doc = Rhino.RhinoDoc.ActiveDoc
    return doc.ModelAngleToleranceRadians if doc else math.radians(1.0)


def _unit(v):
    if v is None:
        return None
    w = rg.Vector3d(v)
    return w if w.Unitize() else None


def _neg(v):
    w = rg.Vector3d(v)
    w.Reverse()
    return w


def _frame(n):
    """Two unit vectors spanning the plane perpendicular to n."""
    a = rg.Vector3d.XAxis if abs(n.X) < 0.9 else rg.Vector3d.YAxis
    e1 = rg.Vector3d.CrossProduct(n, a)
    e1.Unitize()
    e2 = rg.Vector3d.CrossProduct(n, e1)
    e2.Unitize()
    return e1, e2


# ------------------------------------------------------------- input curves
def _discretize(obj, tol, ang_tol):
    """Any curve-ish input -> list of Point3d."""
    crv = obj
    if isinstance(obj, rg.Line):
        crv = rg.LineCurve(obj)
    elif isinstance(obj, rg.Polyline):
        crv = obj.ToPolylineCurve()
    if not isinstance(crv, rg.Curve):
        return None

    ok, pl = crv.TryGetPolyline()
    if ok and pl is not None:
        return [rg.Point3d(p) for p in pl]

    try:
        pc = crv.ToPolyline(tol, ang_tol, 0.0, 0.0)
        if pc is not None:
            return [rg.Point3d(p) for p in pc.ToPolyline()]
    except Exception:
        pass

    ts = crv.DivideByCount(FALLBACK_DIVISIONS, True)
    if ts:
        return [crv.PointAt(t) for t in ts]
    return [crv.PointAtStart, crv.PointAtEnd]


# ------------------------------------------------------------- point lookup
class _PointMap(object):
    """Welds coincident points into node indices via a uniform grid."""

    def __init__(self, tol):
        self.tol = max(tol, 1e-9)
        self.cell = self.tol * 2.0
        self.grid = {}
        self.pts = []

    def _key(self, p):
        c = self.cell
        return (int(math.floor(p.X / c)),
                int(math.floor(p.Y / c)),
                int(math.floor(p.Z / c)))

    def add(self, p):
        kx, ky, kz = self._key(p)
        for dx in (-1, 0, 1):
            for dy in (-1, 0, 1):
                for dz in (-1, 0, 1):
                    for i in self.grid.get((kx + dx, ky + dy, kz + dz), ()):
                        if self.pts[i].DistanceTo(p) <= self.tol:
                            return i
        i = len(self.pts)
        self.pts.append(rg.Point3d(p))
        self.grid.setdefault((kx, ky, kz), []).append(i)
        return i

    def nearest(self, p):
        best, bd = -1, None
        for i, q in enumerate(self.pts):
            d = q.DistanceToSquared(p)
            if bd is None or d < bd:
                bd, best = d, i
        return best


# ------------------------------------------------------------ normal source
class _NormalField(object):
    """Surface normal at the closest point of the base geometry."""

    def __init__(self, base):
        self.brep = None
        self.mesh = None
        if base is None:
            return
        if isinstance(base, rg.Mesh):
            self.mesh = base
        elif isinstance(base, rg.Brep):
            self.brep = base
        elif isinstance(base, rg.Surface):
            self.brep = base.ToBrep()
        elif isinstance(base, rg.Extrusion):
            self.brep = base.ToBrep()
        else:
            try:
                self.brep = rg.Brep.TryConvertBrep(base)
            except Exception:
                self.brep = None

    def ok(self):
        return self.brep is not None or self.mesh is not None

    def at(self, p):
        if self.mesh is not None:
            mp = self.mesh.ClosestMeshPoint(p, 0.0)
            if mp is not None:
                return _unit(self.mesh.NormalAt(mp))
        if self.brep is not None:
            best, bd = None, None
            for face in self.brep.Faces:
                try:
                    rc = face.ClosestPoint(p)
                except Exception:
                    continue
                if not rc or not rc[0]:
                    continue
                u, v = rc[1], rc[2]
                d = face.PointAt(u, v).DistanceToSquared(p)
                if bd is None or d < bd:
                    n = face.NormalAt(u, v)
                    if face.OrientationIsReversed:
                        n.Reverse()
                    bd, best = d, n
            return _unit(best)
        return None


# ------------------------------------------------------------------- widths
def _node_sizes(pmap, adj, node_sizes, size_points, fallback):
    """One half-width per node: seeded from SizePoints, then diffused."""
    n = len(pmap.pts)

    if not node_sizes:
        node_sizes = [fallback]

    if not size_points:
        if len(node_sizes) == 1:
            return [abs(node_sizes[0])] * n
        # no SizePoints given: cycle the list over the nodes in build order
        return [abs(node_sizes[i % len(node_sizes)]) for i in range(n)]

    vals = [None] * n
    for k, sp in enumerate(size_points):
        idx = pmap.nearest(sp)
        if idx >= 0:
            vals[idx] = abs(float(node_sizes[k % len(node_sizes)]))

    known = [v for v in vals if v is not None]
    if not known:
        return [abs(node_sizes[0])] * n

    mean = sum(known) / float(len(known))
    unknown = [i for i in range(n) if vals[i] is None]
    for i in unknown:
        vals[i] = mean

    # discrete harmonic fill: every free node relaxes to the average of its
    # neighbours, which spreads the seeded sizes smoothly across the network
    for _ in range(400):
        shift = 0.0
        for i in unknown:
            nb = adj.get(i)
            if not nb:
                continue
            nv = sum(vals[j] for j in nb) / float(len(nb))
            shift = max(shift, abs(nv - vals[i]))
            vals[i] = nv
        if shift < mean * 1e-5:
            break
    return vals


# -------------------------------------------------------------- chain walks
def _build_chains(adj, junctions, edges):
    """Contract runs of valence-2 nodes, so a junction is only built where the
    network actually branches (and a smooth curve stays one clean ribbon)."""
    chains = []
    used = set()

    def walk(start, first):
        used.add((min(start, first), max(start, first)))
        path = [start, first]
        prev, cur = start, first
        while cur not in junctions:
            nxt = [x for x in adj[cur] if x != prev]
            if not nxt:
                break
            nx = nxt[0]
            e2 = (min(cur, nx), max(cur, nx))
            if e2 in used:
                break
            used.add(e2)
            path.append(nx)
            prev, cur = cur, nx
        return path

    for j in sorted(junctions):
        for nb in adj[j]:
            if (min(j, nb), max(j, nb)) in used:
                continue
            chains.append(walk(j, nb))

    # whatever is left is a closed loop with no branching: promote one node
    for e in edges:
        if e in used:
            continue
        junctions.add(e[0])
        chains.append(walk(e[0], e[1]))

    return chains


def _cumulative(pts):
    cum = [0.0]
    for i in range(1, len(pts)):
        cum.append(cum[-1] + pts[i - 1].DistanceTo(pts[i]))
    return cum


def _span_at(cum, s):
    """Index of the polyline span containing arc length s, plus local t."""
    s = min(max(s, 0.0), cum[-1])
    for i in range(1, len(cum)):
        if s <= cum[i] or i == len(cum) - 1:
            seg = cum[i] - cum[i - 1]
            return i, (0.0 if seg <= 0 else (s - cum[i - 1]) / seg)
    return len(cum) - 1, 1.0


def _sample(pts, cum, s):
    """Point and unit tangent at arc length s along a polyline."""
    i, t = _span_at(cum, s)
    p = pts[i - 1] + (pts[i] - pts[i - 1]) * t
    d = _unit(pts[i] - pts[i - 1]) or rg.Vector3d.XAxis
    return p, d


def _size_at(node_vals, cum, s):
    i, t = _span_at(cum, s)
    return node_vals[i - 1] * (1.0 - t) + node_vals[i] * t


def _blend_normal(normals, path, cum, s):
    i, t = _span_at(cum, s)
    a, b = normals[path[i - 1]], normals[path[i]]
    if a * b < 0:
        b = -b
    return _unit(a * (1.0 - t) + b * t) or a


# ------------------------------------------------------------ blade helpers
def _blade_width_dir(d, flat, node_normal):
    """A strut running along the normal can face anywhere in the tangent
    plane; aim it into the widest gap between the node's other struts."""
    e1, e2 = _frame(node_normal)
    if not flat:
        w = e1 - d * (e1 * d)
        return _unit(w) or _frame(d)[0]

    angs = sorted(it["ang"] for it in flat)
    if len(angs) == 1:
        best = angs[0] + math.pi * 0.5
    else:
        gap, best = -1.0, angs[0]
        for k in range(len(angs)):
            a0 = angs[k]
            a1 = angs[k + 1] if k + 1 < len(angs) else angs[0] + 2.0 * math.pi
            if a1 - a0 > gap:
                gap, best = a1 - a0, (a0 + a1) * 0.5

    w = e1 * math.cos(best) + e2 * math.sin(best)
    w = w - d * (w * d)          # keep it perpendicular to the blade itself
    return _unit(w) or _frame(d)[0]


def _plane_normal(dirs):
    """Normal of the best-fit plane through a bundle of directions: the least
    significant axis of their covariance.  Found by power-iterating on
    trace*I - C, whose dominant axis is C's weakest one."""
    c = [[0.0] * 3 for _ in range(3)]
    for d in dirs:
        v = (d.X, d.Y, d.Z)
        for a in range(3):
            for b in range(3):
                c[a][b] += v[a] * v[b]
    tr = c[0][0] + c[1][1] + c[2][2]
    m = [[(tr if a == b else 0.0) - c[a][b] for b in range(3)] for a in range(3)]

    best, best_q = None, None
    for seed in ((1.0, 0.0, 0.0), (0.0, 1.0, 0.0), (0.0, 0.0, 1.0)):
        v = list(seed)
        for _ in range(60):
            w = [sum(m[a][b] * v[b] for b in range(3)) for a in range(3)]
            L = math.sqrt(sum(x * x for x in w))
            if L < 1e-12:
                break
            v = [x / L for x in w]
        q = sum(v[a] * sum(m[a][b] * v[b] for b in range(3)) for a in range(3))
        if best_q is None or q > best_q:
            best_q, best = q, v
    return _unit(rg.Vector3d(best[0], best[1], best[2])) if best else None


def _fallback_normals(P, adj):
    """No base surface: best-fit plane through each node's struts, then a
    breadth-first pass so neighbouring normals point the same way."""
    normals = []
    for i in range(len(P)):
        dirs = [d for d in (_unit(P[j] - P[i]) for j in adj[i]) if d]
        normals.append(_plane_normal(dirs) if len(dirs) >= 2 else None)

    seen = set()
    for start in range(len(P)):
        if start in seen:
            continue
        comp, k = [start], 0
        seen.add(start)
        while k < len(comp):
            cur = comp[k]
            k += 1
            for nb in adj[cur]:
                if nb not in seen:
                    seen.add(nb)
                    comp.append(nb)

        seed = next((c for c in comp if normals[c] is not None), None)
        if seed is None:
            for c in comp:
                normals[c] = rg.Vector3d.ZAxis
            continue

        done, stack = set([seed]), [seed]
        while stack:
            cur = stack.pop()
            for nb in adj[cur]:
                if nb in done:
                    continue
                done.add(nb)
                if normals[nb] is None:
                    normals[nb] = rg.Vector3d(normals[cur])
                elif normals[nb] * normals[cur] < 0:
                    normals[nb].Reverse()
                stack.append(nb)
        for c in comp:
            if normals[c] is None:
                normals[c] = rg.Vector3d(normals[seed])
    return normals


# --------------------------------------------------------------------- main
def build_flat_lattice(curves, base, node_sizes, size_points,
                       strut_size, end_offset):
    msgs = []
    tol = _tol()

    # --- 1. network -------------------------------------------------------
    polys = []
    for c in curves or []:
        pl = _discretize(c, tol, _ang_tol())
        if pl and len(pl) > 1:
            polys.append(pl)
    if not polys:
        return None, [], ["No usable curves on Curves."]

    pmap = _PointMap(tol * 2.0)
    edges = set()
    for pl in polys:
        idx = [pmap.add(p) for p in pl]
        for a, b in zip(idx[:-1], idx[1:]):
            if a != b:
                edges.add((min(a, b), max(a, b)))
    if not edges:
        return None, [], ["The curve network collapsed to a single point."]

    P = pmap.pts
    adj = dict((i, []) for i in range(len(P)))
    for a, b in edges:
        adj[a].append(b)
        adj[b].append(a)

    diag = rg.BoundingBox(P).Diagonal.Length
    fallback_size = max(diag * 0.01, tol * 10.0)

    # --- 2. widths --------------------------------------------------------
    sizes = [max(s, tol) for s in
             _node_sizes(pmap, adj, node_sizes, size_points, fallback_size)]

    # --- 3. normals -------------------------------------------------------
    field = _NormalField(base)
    normals = [field.at(p) for p in P] if field.ok() else [None] * len(P)
    missing = [i for i, n in enumerate(normals) if n is None]
    if missing:
        if not field.ok():
            msgs.append("No Base geometry: ribbon planes come from a best-fit "
                        "plane at each node instead of a surface normal.")
        elif len(missing) == len(P):
            msgs.append("Could not read a normal anywhere on Base - using a "
                        "best-fit plane at each node instead.")
        else:
            msgs.append("Base gave no normal at %d of %d nodes; those fall back "
                        "to a best-fit plane." % (len(missing), len(P)))
        spare = _fallback_normals(P, adj)
        for i in missing:
            normals[i] = spare[i]

    # --- 4. struts --------------------------------------------------------
    junctions = set(i for i in range(len(P)) if len(adj[i]) != 2)
    chains = _build_chains(adj, junctions, sorted(edges))
    if not chains:
        return None, [], ["Could not trace any struts through the network."]

    ends = dict((j, []) for j in junctions)
    for ci, path in enumerate(chains):
        total = _cumulative([P[i] for i in path])[-1]
        for side in (0, 1):
            node = path[0] if side == 0 else path[-1]
            if node not in ends:
                continue
            nxt = path[1] if side == 0 else path[-2]
            d = _unit(P[nxt] - P[node])
            if d is None:
                continue
            ends[node].append({"chain": ci, "side": side, "dir": d,
                               "seg": P[node].DistanceTo(P[nxt]),
                               "len": total, "off": 0.0})

    # --- 4b. cap each node to what its struts can actually carry ----------
    # A junction needs roughly a half width of clearance along each strut
    # before the ribbon proper begins. Where a strut is shorter than that -
    # the short edges at the open ends of a panelled surface - the two
    # junctions would reach past each other, the mouths would spread beyond a
    # right angle and the hub would fold through itself. Shrink the node
    # instead, so the lattice thins out locally rather than breaking.
    squeezed = 0
    for j, items in ends.items():
        if not items:
            continue
        cap = None
        for it in items:
            # the mouth has to fit inside the first segment of its strut, and
            # the mouths at the two ends of a strut must not reach past each
            # other - whichever binds first sets the limit
            lim = min(0.8 * it["seg"], MAX_SIZE_RATIO * it["len"])
            cap = lim if cap is None else min(cap, lim)
        cap = cap / max(1.0, abs(end_offset))
        if sizes[j] > cap:
            sizes[j] = max(cap, tol)
            squeezed += 1
    if squeezed:
        msgs.append("%d of %d nodes were narrower than NodeSize asks for: "
                    "their struts are shorter than the ribbon is wide, so the "
                    "ribbon tapers there instead of folding over itself."
                    % (squeezed, len(ends)))

    # --- 5. width direction and mouth offset for every strut end ----------
    blade_limit = math.sqrt(max(1.0 - BLADE_DOT * BLADE_DOT, 0.0))
    anchored = {}     # does this node have a strut that pins its orientation?

    for j, items in ends.items():
        if not items:
            continue
        n = normals[j]
        e1, e2 = _frame(n)
        hw = sizes[j]

        # width direction per strut: perpendicular to the strut and as close
        # to the surface tangent plane as possible
        flat, blades = [], []
        for it in items:
            cx = rg.Vector3d.CrossProduct(n, it["dir"])
            it["blade"] = cx.Length < blade_limit
            if it["blade"]:
                blades.append(it)
            else:
                cx.Unitize()
                it["w"] = cx
                it["ang"] = math.atan2(it["dir"] * e2, it["dir"] * e1)
                flat.append(it)
        for it in blades:
            it["w"] = _blade_width_dir(it["dir"], flat, n)
        anchored[j] = len(flat) > 0

        # offsets: the user's value, but never tighter than the miter the
        # junction geometrically needs to keep its ribbons from crossing
        for it in items:
            if len(items) < 2:
                it["off"] = 0.0
                continue
            off = max(abs(end_offset) * hw, hw)
            for other in flat:
                if other is it:
                    continue
                dot = max(-1.0, min(1.0, it["dir"] * other["dir"]))
                th = math.acos(dot)
                if 1e-6 < th < math.pi - 1e-6:
                    off = max(off, min(hw / math.tan(th * 0.5), MAX_MITER * hw))
            it["off"] = max(min(off, it["seg"] * 0.9, it["len"] * 0.45), 0.0)

    # --- 6. stations along every strut ------------------------------------
    # A blade can face anywhere, so a node whose struts are ALL blades has no
    # orientation of its own: it takes one from the far end of the strut.
    stations = []
    for cidx, path in enumerate(chains):
        pts = [P[i] for i in path]
        cum = _cumulative(pts)
        total = cum[-1]
        if total <= tol:
            stations.append(None)
            continue
        node_vals = [sizes[i] for i in path]

        head = _end_item(ends, path[0], cidx, 0)
        tail = _end_item(ends, path[-1], cidx, 1)
        s0 = head["off"] if head else 0.0
        s1 = total - (tail["off"] if tail else 0.0)
        if s1 - s0 < tol:
            mid = total * 0.5
            s0, s1 = mid - tol, mid + tol

        avg_hw = max(sum(node_vals) / float(len(node_vals)), tol)

        # Stations sit on every interior vertex of the chain, so the ribbon
        # follows the input curve exactly, plus enough extra samples that no
        # quad gets much longer than the ribbon is wide.
        knots = [s0] + [c for c in cum[1:-1] if s0 + tol < c < s1 - tol] + [s1]
        svals = []
        for k in range(len(knots) - 1):
            a, b = knots[k], knots[k + 1]
            n_sub = max(MIN_SPANS if len(knots) == 2 else 1,
                        min(MAX_SPANS, int(round((b - a) / (avg_hw * 2.0)))))
            for q in range(n_sub):
                svals.append(a + (b - a) * q / float(n_sub))
        svals.append(s1)
        spans = len(svals) - 1

        if head is not None and anchored.get(path[0], True):
            seed = rg.Vector3d(head["w"])
        elif tail is not None:
            seed = _neg(tail["w"])   # the far node measures direction the other way
        else:
            seed = None

        # transport the width direction along the strut so it never flips
        rec = {"spans": spans, "w": [], "p": [], "hw": []}
        w_prev = seed
        run_len = max(s1 - s0, tol)
        for s in svals:
            t = (s - s0) / run_len
            p, d = _sample(pts, cum, s)
            n = field.at(p) if field.ok() else None
            if n is None:
                n = _blend_normal(normals, path, cum, s)
            w = _unit(rg.Vector3d.CrossProduct(n, d))
            if w is None:
                w = rg.Vector3d(w_prev) if w_prev is not None else _frame(n)[0]
            if w_prev is not None and w * w_prev < 0.0:
                w.Reverse()
            w_prev = w

            bulge = 1.0 + (strut_size - 1.0) * math.sin(math.pi * t)
            rec["p"].append(p)
            rec["w"].append(w)
            rec["hw"].append(max(_size_at(node_vals, cum, s) * bulge, tol))
        stations.append(rec)

        # hand the settled direction back to any end that had none
        if head is not None and head["blade"] and not anchored.get(path[0], True):
            head["w"] = rg.Vector3d(rec["w"][0])
        if tail is not None and tail["blade"] and not anchored.get(path[-1], True):
            tail["w"] = _neg(rec["w"][-1])

    # --- 7. junction hubs -------------------------------------------------
    mesh = rg.Mesh()
    corner = {}   # (chain index, side) -> (left vertex, right vertex)

    for j, items in ends.items():
        if not items:
            continue
        n = normals[j]
        e1, e2 = _frame(n)
        hw = sizes[j]
        ci = mesh.Vertices.Add(P[j])

        # when two neighbouring ribbons miter exactly, their inner corners land
        # on the same point - share one vertex instead of stacking two
        placed = []
        cpt = {}

        def _corner(pt):
            for q, idx in placed:
                if q.DistanceTo(pt) <= tol:
                    return idx
            idx = mesh.Vertices.Add(pt)
            placed.append((pt, idx))
            cpt[idx] = pt
            return idx

        ring = {}
        for it in items:
            c = P[j] + it["dir"] * it["off"]
            pa, pb = c + it["w"] * hw, c - it["w"] * hw
            a, b = _corner(pa), _corner(pb)      # left (+w), right (-w)
            corner[(it["chain"], it["side"])] = (a, b)
            va, vb = pa - P[j], pb - P[j]
            ring[b] = math.atan2(vb * e2, vb * e1)
            ring[a] = math.atan2(va * e2, va * e1)

        # fan the hub from the node through its corners in counter-clockwise
        # order; a blade's two corners sit on opposite sides of the ring, so
        # it gets stitched in rather than leaving a slit
        order = sorted(ring.keys(), key=lambda i: ring[i])
        if len(order) >= 3:
            for k in range(len(order)):
                v1, v2 = order[k], order[(k + 1) % len(order)]
                # a gap wider than a half turn is open space on the far side of
                # the node, not material: leave it empty instead of folding a
                # reflex triangle back over the hub
                gap = (ring[v2] - ring[v1]) % (2.0 * math.pi)
                if gap >= math.pi - 1e-9:
                    continue
                area = rg.Vector3d.CrossProduct(cpt[v1] - P[j],
                                                cpt[v2] - P[j]).Length * 0.5
                if area > tol * tol:
                    mesh.Faces.AddFace(ci, v1, v2)

    # --- 8. strut ribbons -------------------------------------------------
    for cidx, rec in enumerate(stations):
        if rec is None:
            continue
        c0 = corner.get((cidx, 0))
        c1 = corner.get((cidx, 1))
        spans = rec["spans"]

        left, right = [], []
        for k in range(spans + 1):
            if k == 0 and c0:
                left.append(c0[0])
                right.append(c0[1])
            elif k == spans and c1:
                # the far node measures direction the other way round, so its
                # "left" corner is this ribbon's right edge
                left.append(c1[1])
                right.append(c1[0])
            else:
                p, w, hw = rec["p"][k], rec["w"][k], rec["hw"][k]
                left.append(mesh.Vertices.Add(p + w * hw))
                right.append(mesh.Vertices.Add(p - w * hw))

        for k in range(spans):
            mesh.Faces.AddFace(left[k], right[k], right[k + 1], left[k + 1])

    # --- 9. tidy ----------------------------------------------------------
    # vertices are already shared where ribbons meet, so the mesh is welded by
    # construction; Compact just drops the hub centres of dead-end nodes
    mesh.Compact()
    mesh.FaceNormals.ComputeFaceNormals()
    mesh.UnifyNormals()
    mesh.Normals.ComputeNormals()

    outlines = []
    try:
        for pl in (mesh.GetNakedEdges() or []):
            outlines.append(pl.ToPolylineCurve())
    except Exception:
        pass

    return mesh, outlines, msgs


def _end_item(ends, node, chain, side):
    for it in ends.get(node, []):
        if it["chain"] == chain and it["side"] == side:
            return it
    return None


# --------------------------------------------------------- Grasshopper glue
def _inp(name, default=None):
    v = globals().get(name, None)
    return default if v is None else v


def _as_list(v):
    """Tolerate an input whose access was left on Item rather than List."""
    if v is None:
        return []
    if isinstance(v, str):
        return [v]
    try:
        return [x for x in v if x is not None]
    except TypeError:
        return [v]


def _as_number(v, default):
    for x in _as_list(v):
        try:
            return float(x)
        except (TypeError, ValueError):
            pass
    return default


def _warn(text):
    try:
        import Grasshopper
        ghenv.Component.AddRuntimeMessage(
            Grasshopper.Kernel.GH_RuntimeMessageLevel.Warning, text)
    except Exception:
        print(text)


_curves = _as_list(_inp("Curves"))
_base = _inp("Base", None)
if isinstance(_base, (list, tuple)):
    _base = _base[0] if _base else None
_sizes = [float(s) for s in _as_list(_inp("NodeSize"))]
_spts = _as_list(_inp("SizePoints"))
_strut = _as_number(_inp("StrutSize"), 1.0)
_endoff = _as_number(_inp("EndOffset"), 1.0)

Mesh, Outlines, _msgs = build_flat_lattice(
    _curves, _base, _sizes, _spts, _strut, _endoff)

for _m in _msgs:
    _warn(_m)
# ---------- end flat_multipipe ----------
weaverbird_s_catmull_clark_subdivision = WeaverbirdsCatmullClarkSubdivision(MeshCurves=flat_multipipe.Mesh, Level=Slider(3, range=0..10), SmoothNakedEdges=2)
multipipe = MultiPipe(Curves=flatten(merge_4), NodeSize=ends_thickness, EndOffset=1, StrutSize=1, Segment=0, KinkAngle=0.6, CubeFit=0, Caps=0)
multipipe_2 = MultiPipe(Curves=flatten(merge_6), NodeSize=ends_thickness, EndOffset=1, StrutSize=1, Segment=0, KinkAngle=0.6, CubeFit=0, Caps=0)
# Final form creation
weaverbird_s_mesh_thicken = WeaverbirdsMeshThicken(MeshCurves=weaverbird_s_catmull_clark_subdivision, Distance=thickness, OffsetType=0)
mesh_brep = MeshBrep(
    Brep=multipipe_2,
    Settings={GridMaxCount=0, GridMinCount=16, JaggedSeams=False, MaxEdgeLength=0, MinEdgeLength=0.0001, MinTolerance=0, Refine=True, RefineAngle=0, RelativeTolerance=0.65, SimplePlanes=True, Tolerance=0})
mesh_brep_2 = MeshBrep(
    Brep=multipipe,
    Settings={GridMaxCount=0, GridMinCount=16, JaggedSeams=False, MaxEdgeLength=0, MinEdgeLength=0.0001, MinTolerance=0, Refine=True, RefineAngle=0, RelativeTolerance=0.65, SimplePlanes=True, Tolerance=0})
merge_7 = Merge(Data1=weaverbird_s_mesh_thicken, Data2=mesh_brep_2, Data3=mesh_brep)  # -> flatten(Result)
mesh_join = MeshJoin(Meshes=merge_7)
weaverbird_s_blur_mesh = WeaverbirdsBlurMesh(MeshCurves=mesh_join, Level=Slider(3, range=0..100), Thin=1)
custom_preview_3 = CustomPreview(Geometry=weaverbird_s_blur_mesh, Material=ColourSwatch(SwatchColor=RGB(61, 68, 130)))
